# Grasshopper definition fuso_2.gh (Grasshopper 1.0.7)
# plug-ins: HelixGH

# ---- group: Diametro Tubo Interno
diametro_de_rosca = Slider(50, range=0..100)
panel = Panel(diametro_de_rosca)

# ---- group: Diametro Fuso
tolerancia_da_barril = Panel("0.15")
subtraction = Subtraction(A=diametro_de_rosca, B=tolerancia_da_barril)
panel_2 = Panel(subtraction)

# ---- group: Profundidade ZA
multiplication = Multiplication(A=subtraction, B="0.12")
subtraction_2 = Subtraction(A=subtraction, B=multiplication)

# ---- group: Profundidade ZC
multiplication_2 = Multiplication(A=subtraction, B="0.12")
subtraction_3 = Subtraction(A=subtraction, B=multiplication_2)

# ---- group: Profundidade ZD Inicio
multiplication_3 = Multiplication(A=subtraction, B="0.05")
subtraction_4 = Subtraction(A=subtraction, B=multiplication_3)

# ---- group: Profundidade ZD Final
multiplication_4 = Multiplication(A=subtraction, B="0.03")
subtraction_5 = Subtraction(A=subtraction, B=multiplication_4)

# ---- group: Diametro externo do tubo
espeçura_tubo = Panel()
addition = Addition(A=diametro_de_rosca, B=espeçura_tubo)
panel_3 = Panel(addition)

# ---- group: Comprimento
d_20 = Panel("20")
# GNU nano 7.2                                    Fuso.md                                             | **Parte** | **Tamanho** | **Profundidade** |
# |---|---|---|
# | Comprimento (L) | 20xD | - |
# | Diametro (D) | L/20 | - |
# | Passo da Rosca (P) | P=D | - |
# | Zona de Aliemntação (ZA) | Lx0.3 | Dx0.12 |
# | Zona de Compressão (ZC) | Lx0.4 | |
# | Zona de Dosagem (ZD) | Lx0.3 | Dx(0.03 ~ 0.05) |
# | Angulo | 17º ~ 20º | - |
multiplication_5 = Multiplication(A=diametro_de_rosca, B=d_20)
panel_4 = Panel(multiplication_5)

# ---- group: Comprimento ZA
multiplication_6 = Multiplication(A=multiplication_5, B="0.3")

# ---- group: Comprimento ZC
multiplication_7 = Multiplication(A=multiplication_5, B="0.4")
addition_2 = Addition(A=multiplication_6, B=multiplication_7)

# ---- group: Comprimento ZD
multiplication_8 = Multiplication(A=multiplication_5, B="0.3")
addition_3 = Addition(A=addition_2, B=multiplication_8)

# ---- group: Raio Interno do Fuso
pt = ConstructPoint(XCoordinate="0", YCoordinate="0", ZCoordinate="0")

Z = UnitZ(Factor=multiplication_5)
move = Move(Geometry=pt, Motion=Z)  # -> Geometry, Transform
cir_zd_f = Circle(Plane=move.Geometry, Radius=expr("x/2", subtraction_5))

Z_2 = UnitZ(Factor=addition_2)
move_2 = Move(Geometry=pt, Motion=Z_2)  # -> Geometry, Transform
cir_zd_i = Circle(Plane=move_2.Geometry, Radius=expr("x/2", subtraction_4))

Z_3 = UnitZ(Factor=multiplication_6)
move_3 = Move(Geometry=pt, Motion=Z_3)  # -> Geometry, Transform
cir_zc_i = Circle(Plane=move_3.Geometry, Radius=expr("x/2", subtraction_3))

cir_za_i = Circle(Plane=pt, Radius=expr("x/2", subtraction_2))

# ---- group: Supoerfice do fuso
ln = Line(StartPoint=pt, EndPoint=move.Geometry)
swp1 = Sweep1(Rail=ln, Sections=[cir_za_i, cir_zc_i, cir_zd_i, cir_zd_f], Miter=2)

# ---- group: Pontos do fuso
division = Division(A=subtraction, B="2")
divlength = DivideLength(Curve=ln, Length=division)  # -> Points, Tangents, Parameters
lng = ListLength(List=divlength.Points)

subtraction_6 = Subtraction(A=lng, B="1")
sdivide = DivideSurface(Surface=swp1, UCount=subtraction_6, VCount=Slider(2, range=0..10))  # -> Points, Normals, Parameters

item = ListItem(List=sdivide.Points, Index=Slider(1, range=0..2), Wrap=True)  # -> flatten(Item)
item_2 = ListItem(List=sdivide.Points, Index=Slider(0, range=0..2), Wrap=True)  # -> flatten(Item)
cull = CullPattern(List=item_2, CullPattern=[True, False])

shift = ShiftList(List=item, Shift="1", Wrap=True)
cull_2 = CullPattern(List=shift, CullPattern=[True, False])

shift_2 = ShiftList(List=item_2, Shift="2", Wrap=True)
cull_3 = CullPattern(List=shift_2, CullPattern=[True, False])

# ----
data = Data(swp1)

# ---- group: Pontos do fuso
ln_2 = Line(StartPoint=cull_2, EndPoint=cull_3)
subset = SubList(List=ln_2, Domain="19", Wrap=True)  # -> List, Index

ln_3 = Line(StartPoint=cull, EndPoint=cull_2)
subset_2 = SubList(List=ln_3, Domain="19", Wrap=True)  # -> List, Index

# ----
join = JoinCurves(Curves=[subset_2.List, subset.List], Preserve=False)

comprimento_l = Slider(100, range=0..500)
multiplication_9 = Multiplication(A=comprimento_l, B=10)
panel_5 = Panel(multiplication_9)
Z_4 = UnitZ(Factor=Slider(2.5, range=0..10))
neg = Negative(Value=Z_4)
pt_2 = ConstructPoint(XCoordinate="0", YCoordinate="0", ZCoordinate="0")
Z_5 = UnitZ(Factor="3")
ln_4 = Line(StartPoint=pt_2, EndPoint=Z_5)

# ---- group: Zona de Dosagem (ZD)
multiplication_10 = Multiplication(A=multiplication_9, B="0.3")

# ---- group: Zona de Alimentação (ZA)
multiplication_11 = Multiplication(A=multiplication_9, B="0.3")

# ---- group: Zona de Compressão (ZC)
multiplication_12 = Multiplication(A=multiplication_9, B="0.4")

# ---- group: Diametro
l_20 = Panel("20")
division_2 = Division(A=multiplication_9, B=l_20)

# ---- group: profundidade ZA
multiplication_13 = Multiplication(A=division_2, B="0.12")

# ----
division_3 = Division(A=multiplication_9, B=division_2)
paso_da_rosca_p = Data(division_2)
helix_curve = HelixCurve(Diameter=division_2, Taper=1, Infinite="true", Pitch=paso_da_rosca_p, Turns=division_3, Reverse=False)  # -> Helix, Height

division_4 = Division(A=division_2, B=2)
cir = Circle(Plane=PlaneXY(0, 0, 0), Radius=division_4)
Z_6 = UnitZ(Factor=multiplication_9)
srf = Surface(cir)
extr = Extrude(Base=srf, Direction=Z_6)  # -> flatten(Extrusion)

X = UnitX(Factor=multiplication_13)
panel_6 = Panel(division_2)
divide = DivideCurve(Curve=helix_curve.Helix, Count="3", Kinks=False)  # -> Points, Tangents, Parameters
item_3 = ListItem(List=divide.Points, Index=0, Wrap=True)
xz = XZPlane(Origin=item_3)
item_4 = ListItem(List=divide.Points, Index="3", Wrap=True)
data_2 = Data(item_4)
data_3 = Data(helix_curve.Helix)

pt_3 = Point(xz)

move_4 = Move(Geometry=pt_3, Motion=Z_4)  # -> Geometry, Transform
move_5 = Move(Geometry=move_4.Geometry, Motion=expr("x*-1", X))  # -> Geometry, Transform
ln_5 = Line(StartPoint=pt_3, EndPoint=move_4.Geometry)
xz_2 = XZPlane(Origin=move_4.Geometry)

ln_6 = Line(StartPoint=move_4.Geometry, EndPoint=move_5.Geometry)
rotate = Rotate(Geometry=ln_6, Angle="-0.349", Plane=xz_2)  # -> Geometry, Transform

move_6 = Move(Geometry=ln_6, Motion=neg)  # -> Geometry, Transform
mirror = MirrorCurve(Geometry=[ln_5, rotate.Geometry], Curve=move_6.Geometry, Tangent=True)
join_2 = JoinCurves(Curves=[mirror, rotate.Geometry, ln_5], Preserve=False)
move_7 = Move(Geometry=join_2, Motion=data_2)  # -> Geometry, Transform
railrev = RailRevolution(Curve=join_2, Rail=data_3, Axis=ln_4, Scale=False)
